# Dynamo graph IR_Analysis.dyn (Dynamo 3.4.1.0)
# Infrared analysis for Revit 2026. Select the buildings in Revit, type a command (for example svf, or help), press Run.

# group: 1. Select the buildings in Revit, or type select here, press Run and click them. 2. Type a command here. 3. Press Run. Examples: svf | pwc run | wind 5 270 run | solar both context run | daylight facades model run keep | show-last legend exact | export-obj | set-key | help. Without the word run it is a free preview of the cost.
command = StringInput("help")  # graph input

python_script_analysis = Python(IN[0]=command)  # CPython3
# ---------- python_script_analysis.python (23 lines) ----------
# Infrared analysis for Revit. No logic here: all of it is in the libs folder.
# IN[0] is the command line. The buildings are the selection of Revit.
import os, sys, traceback
try:
    # The folder of the unzipped libs. INFRARED_DYNAMO_LIBS names another folder.
    libs = os.environ.get('INFRARED_DYNAMO_LIBS') or os.path.join(os.environ.get('APPDATA', ''), 'Infrared', 'revit-dynamo')
    if not os.path.isdir(os.path.join(libs, 'ir_revit')):
        raise RuntimeError('The Infrared libs are not in %s. Unzip infrared-dynamo-libs.zip there (see the README).' % libs)
    if libs not in sys.path:
        sys.path.insert(0, libs)
    # Forget the loaded ir_* modules: the next import reads every edited file again.
    # (importlib.reload one by one can leave an old module in place.)
    for name in [m for m in sys.modules if m.split('.')[0] in ('ir_dynamo', 'ir_revit')]:
        del sys.modules[name]
    from ir_revit.entry import run
    OUT = run(command=IN[0])
except Exception:
    OUT = ['Script error (also in ~/.infrared/revit-dynamo-runs.log):'] + traceback.format_exc().splitlines()
    try:
        with open(os.path.join(os.path.expanduser('~'), '.infrared', 'revit-dynamo-runs.log'), 'a') as log:
            log.write('=== script error\n' + traceback.format_exc() + '\n')
    except Exception:
        pass
# ----------------------------------------
watch = Watch(python_script_analysis)  # graph output
